# Grasshopper definition 02-06-24 Class Demo.gh (Grasshopper 1.0.7)

genes = GenePool(Decimals=2, Maximum=100, Minimum=0, Value=[11.85283503, 57.36267341, 20.15140309, 67.40393842])
genes_2 = GenePool(Decimals=2, Maximum=100, Minimum=0, Value=[94.51587116, 16.67632191, 45.87, 62.88432207])
genes_3 = GenePool(Decimals=2, Maximum=100, Minimum=0, Value=[36.2, 59.62, 5.71, 0])
genes_4 = GenePool(Decimals=2, Maximum=100, Minimum=0, Value=[14.57, 88.63, 0])
genes_5 = GenePool(Decimals=2, Maximum=100, Minimum=0, Value=[15.98, 24.25, 51.71])
genes_6 = GenePool(Decimals=2, Maximum=100, Minimum=0, Value=[11.98, 50.96, 59.52])
pt = ConstructPoint(XCoordinate=genes, YCoordinate=genes_3, ZCoordinate=genes_2)
panel = Panel(pt)
viewer = ParamViewer(pt)
viewer_2 = ParamViewer(pt)
item = ListItem(List=pt, Index=Slider(1, range=0..10), Wrap=True)
item_2 = ListItem(List=pt, Index=Slider(0, range=0..10), Wrap=True)
item_3 = ListItem(List=pt, Index=Slider(2, range=0..10), Wrap=True)
item_4 = ListItem(List=pt, Index=Slider(3, range=0..10), Wrap=True)
pt_2 = ConstructPoint(XCoordinate=genes_6, YCoordinate=genes_5, ZCoordinate=genes_4)
graft = GraftTree(Tree=pt, IncludeEmptyLists=True, IncludeNullItems=True)
viewer_3 = ParamViewer(graft)
viewer_4 = ParamViewer(graft)
pline = PolyLine(Vertices=pt_2, Closed=False)
srf4pt = _4PointSurface(CornerA=item_4, CornerB=item_3, CornerC=item, CornerD=item_2)
points = PointList(Points=graft, Size=Slider(8, range=0..100))
divide = DivideDomain²(Domain=srf4pt, UCount=Slider(4, range=0..10), VCount=Slider(8, range=0..10))
subsrf = Isotrim(Surface=srf4pt, Domain=divide)
pull = PullCurve(Curve=pline, Surface=subsrf)
area = Area(Geometry=subsrf)  # -> Area, Centroid
move = Move(Geometry=pull, Motion=Vector(0, 0, 10))  # -> Geometry, Transform
brep_cp = BrepClosestPoint(Point=area.Centroid, Brep=subsrf)  # -> Point, Normal, Distance
points_2 = PointList(Points=area.Centroid, Size=Slider(3, range=0..100))
