# Grasshopper definition 02-08-24 Class Demo.gh (Grasshopper 1.0.7)

series = Series(Start=0, Step=1, Count=10)
series_2 = Series(Start=0, Step=1, Count=10)  # -> graft(Series)
construct_point = ConstructPoint(XCoordinate=Slider(3, range=0..11), YCoordinate=Slider(3, range=0..11), ZCoordinate=Slider(4, range=0..10))
series_3 = Series(Start=0, Step=1, Count=10)
series_4 = Series(Start=0, Step=1, Count=10)  # -> graft(Series)
series_5 = Series(Start=0, Step=1, Count=10)
series_6 = Series(Start=0, Step=1, Count=10)  # -> graft(Series)
construct_point_2 = ConstructPoint(XCoordinate=series_2, YCoordinate=series, ZCoordinate=0)  # -> flatten(Point)
construct_point_3 = ConstructPoint(XCoordinate=Slider(2.06, range=0..11), YCoordinate=Slider(5.488, range=0..11), ZCoordinate=Slider(0, range=0..10))
construct_point_4 = ConstructPoint(XCoordinate=series_4, YCoordinate=series_3, ZCoordinate=Slider(5, range=0..10))  # -> flatten(Point)
construct_point_5 = ConstructPoint(XCoordinate=series_6, YCoordinate=series_5, ZCoordinate=0)  # -> flatten(Point)

data = Data(construct_point_5)
param_viewer = ParamViewer(data)
param_viewer_2 = ParamViewer(data)
panel = Panel(data)
point_list = PointList(Points=data, Size=Slider(0.405, range=0..10))

closest_point = ClosestPoint(Point=construct_point, Cloud=construct_point_5)  # -> ClosestPoint, CPIndex, Distance
distance = Distance(PointA=construct_point_2, PointB=construct_point_3)
point = Point(construct_point_2)
polygon = Polygon(Plane=point, Radius=Slider(0.5, range=0..1), Segments=6, FilletRadius=0)  # -> Polygon, Length
line = Line(StartPoint=construct_point_5, EndPoint=construct_point)
cull_pattern = CullPattern(List=construct_point_5, CullPattern=[False, False, True, True])
shift_list = ShiftList(List=construct_point_4, Shift=Slider(4, range=0..10), Wrap=True)
line_2 = Line(StartPoint=closest_point.ClosestPoint, EndPoint=construct_point)
construct_domain = ConstructDomain(DomainStart=Slider(1, range=0..1), DomainEnd=Slider(0.01, range=0.01..1))
bounds = Bounds(Numbers=distance)
sort_list = SortList(Keys=line, ValuesA=construct_point_5)  # -> Keys, ValuesA
sort_list_2 = SortList(Keys=distance, ValuesValuesA=construct_point_2)  # -> Keys, ValuesValuesA
polygon_center = PolygonCenter(Polyline=polygon.Polygon)  # -> CenterV, CenterE, CenterA
construct_point_6 = ConstructPoint(XCoordinate=Slider(0, range=0..10), YCoordinate=Slider(0, range=0..10), ZCoordinate=Slider(0, range=0..10))
construct_point_7 = ConstructPoint(XCoordinate=Slider(8, range=0..10), YCoordinate=Slider(7, range=0..10), ZCoordinate=Slider(7, range=0..10))
cull_pattern_2 = CullPattern(List=shift_list, CullPattern=[False, False, True, True])
remap_numbers = RemapNumbers(Value=distance, Source=bounds, Target=construct_domain)  # -> Mapped, Clipped
line_3 = Line(StartPoint=cull_pattern, EndPoint=cull_pattern_2)
scale = Scale(Geometry=polygon.Polygon, Center=polygon_center.CenterV, Factor=remap_numbers.Mapped)  # -> Geometry, Transform
box_2pt = Box2Pt(PointA=construct_point_6, PointB=construct_point_7, Plane=PlaneXY(0, 0, 0))
unit_z = UnitZ(Factor=scale.Geometry)
polygon_center_2 = PolygonCenter(Polyline=polygon.Polygon)  # -> CenterV, CenterE, CenterA

data_2 = Data(sort_list_2.ValuesValuesA)
param_viewer_3 = ParamViewer(data_2)
param_viewer_4 = ParamViewer(data_2)
panel_2 = Panel(data_2)
point_list_2 = PointList(Points=data_2, Size=Slider(0.405, range=0..10))

deconstruct_brep = DeconstructBrep(Brep=box_2pt)  # -> Faces, Edges, Vertices
extrude = Extrude(Base=scale.Geometry, Direction=unit_z)
move = Move(Geometry=polygon_center_2.CenterV, Motion=unit_z)  # -> Geometry, Transform
list_item = ListItem(List=deconstruct_brep.Faces, Index=Slider(5, range=0..10), Wrap=True)
point_2 = Point(move.Geometry)
surface_from_points = SurfaceFromPoints(Points=point_2, UCount=Slider(10, range=0..10), Interpolate=False)
construct_point_8 = ConstructPoint(XCoordinate=Slider(0, range=0..10), YCoordinate=Slider(0, range=0..10), ZCoordinate=Slider(0, range=0..10))
construct_point_9 = ConstructPoint(XCoordinate=Slider(3, range=0..10), YCoordinate=Slider(3, range=0..10), ZCoordinate=Slider(0, range=0..10))
construct_point_10 = ConstructPoint(XCoordinate=Slider(3, range=0..10), YCoordinate=Slider(4, range=0..10), ZCoordinate=Slider(0, range=0..10))
plane_3pt = Plane3Pt(PointA=construct_point_8, PointB=construct_point_9, PointC=construct_point_10)
rotate = Rotate(Geometry=list_item, Angle=degrees(Slider(466, range=0..1000)), Plane=plane_3pt)  # -> Geometry, Transform
polygon_center_3 = PolygonCenter(Polyline=list_item)  # -> CenterV, CenterE, CenterA
vector_2pt = Vector2Pt(PointB=polygon_center_3.CenterV, Unitize=construct_point_7)  # -> Vector, Length
move_2 = Move(Geometry=rotate.Geometry, Motion=vector_2pt.Vector)  # -> Geometry, Transform
