# Grasshopper definition 02-13-24 Class Demo.gh (Grasshopper 1.0.7)

construct_point = ConstructPoint(XCoordinate=Slider(0, range=0..10), YCoordinate=Slider(0, range=0..10), ZCoordinate=Slider(6, range=0..10))
construct_point_2 = ConstructPoint(XCoordinate=Slider(0, range=0..10), YCoordinate=Slider(0, range=0..10), ZCoordinate=Slider(10, range=0..10))
construct_point_3 = ConstructPoint(XCoordinate=Slider(0, range=0..10), YCoordinate=Slider(0, range=0..10), ZCoordinate=Slider(0, range=0..10))
merge = Merge(Data1=construct_point_3, Data2=construct_point, Data3=construct_point_2)

merge_2 = Merge(Data1=Slider(9, range=0..10), Data2=Slider(7, range=0..10), Data3=Slider(5, range=0..10))

panel = Panel("""8
12
10""")
curve = Curve(<curve referenced from the Rhino model>)
gene_pool = GenePool(Decimals=2, Maximum=100, Minimum=0, Value=[13.22, 10.2, 8.47, 9.27, 10.26, 12.39])
divide_curve = DivideCurve(Curve=curve, Count=Slider(6, range=0..10), Kinks=Toggle(False))  # -> Points, Tangents, Parameters
gene_pool_2 = GenePool(
    Decimals=2,
    Maximum=100,
    Minimum=0,
    Value=[24.58, 30.14, 38.4, 47.97, 40.24877326, 40.51194239, 46.76242339, 58.23383117, 52.69823754, 54.05433517])
gene_pool_3 = GenePool(
    Decimals=2,
    Maximum=100,
    Minimum=0,
    Value=[42.7447061, 19.08, 46.34604995, 47.12, 40.42437084, 55.98220458, 47.29005531, 57.18257697, 47.90555157, 49.96123265])
gene_pool_4 = GenePool(
    Decimals=2,
    Maximum=100,
    Minimum=0,
    Value=[70.92, 55.04, 49.90024796, 47.54, 47.11991357, 55.19994491, 49.32944675, 51.40208019, 58.49676557, 58.64])
construct_point_4 = ConstructPoint(XCoordinate=Slider(0, range=0..10), YCoordinate=Slider(0, range=0..10), ZCoordinate=Slider(0, range=0..10))
construct_point_5 = ConstructPoint(XCoordinate=Slider(0, range=0..10), YCoordinate=Slider(0, range=0..10), ZCoordinate=Slider(5, range=0..10))
construct_point_6 = ConstructPoint(XCoordinate=Slider(0, range=0..10), YCoordinate=Slider(0, range=0..10), ZCoordinate=Slider(10, range=0..10))
construct_point_7 = ConstructPoint(XCoordinate=gene_pool_4, YCoordinate=gene_pool_2, ZCoordinate=gene_pool_3)
circle_cnr = CircleCNR(Center=construct_point_4, Normal=Vector(0, 0, 1), Radius=Slider(9, range=0..10))
circle_cnr_2 = CircleCNR(Normal=Vector(0, 0, 1), Radius=Slider(5, range=0..10))
circle_cnr_3 = CircleCNR(Center=construct_point_5, Normal=Vector(0, 0, 1), Radius=Slider(5, range=0..10))
circle_cnr_4 = CircleCNR(Center=construct_point_6, Normal=Vector(0, 0, 1), Radius=Slider(9, range=0..10))
circle_cnr_5 = CircleCNR(Center=divide_curve.Points, Normal=Vector(0, 0, 1), Radius=gene_pool)
panel_2 = Panel(circle_cnr_5)
polyline = PolyLine(Vertices=construct_point_7, Closed=False)
number_slider = Slider(10, range=0..10)
divide_curve_2 = DivideCurve(Curve=circle_cnr_5, Count=number_slider, Kinks=Toggle(False))  # -> simplify(Points), Tangents, Parameters
panel_3 = Panel(divide_curve_2.Points)
divide_curve_3 = DivideCurve(Curve=circle_cnr_2, Count=Slider(10, range=0..10), Kinks=Toggle(False))  # -> Points, Tangents, Parameters
divide_curve_4 = DivideCurve(Curve=circle_cnr_3, Count=Slider(10, range=0..10), Kinks=Toggle(False))  # -> Points, Tangents, Parameters
divide_curve_5 = DivideCurve(Curve=circle_cnr_4, Count=Slider(10, range=0..10), Kinks=Toggle(False))  # -> Points, Tangents, Parameters
curve_array = CurveArray(Geometry=circle_cnr, Curve=polyline, Count=10)  # -> Geometry, Transform
param_viewer = ParamViewer(divide_curve_2.Points)
shift_list = ShiftList(List=divide_curve_4.Points, Shift=Slider(4, range=0..10), Wrap=Toggle(True))
panel_4 = Panel(curve_array.Geometry)
divide_curve_6 = DivideCurve(Curve=curve_array.Geometry, Count=Slider(3, range=0..10), Kinks=Toggle(False))  # -> simplify(Points), Tangents, Parameters
param_viewer_2 = ParamViewer(divide_curve_6.Points)
line = Line(EndPoint=divide_curve_3.Points)
line_2 = Line(StartPoint=shift_list, EndPoint=divide_curve_5.Points)
panel_5 = Panel(divide_curve_6.Points)
list_item = ListItem(List=divide_curve_6.Points, Index=Slider(2, range=0..10), Wrap=True)  # -> flatten(Item)
list_item_2 = ListItem(List=divide_curve_6.Points, Index=Slider(0, range=0..10), Wrap=True)  # -> flatten(Item)
list_item_3 = ListItem(List=divide_curve_6.Points, Index=Slider(1, range=0..10), Wrap=True)  # -> flatten(Item)
panel_6 = Panel(list_item_2)
polyline_2 = PolyLine(Vertices=list_item_3, Closed=False)
polyline_3 = PolyLine(Vertices=list_item, Closed=False)
polyline_4 = PolyLine(Vertices=list_item_2, Closed=False)
explode_tree = ExplodeTree(Data=divide_curve_6.Points)  # -> Branch0, Branch1, Branch2, Branch3
line_3 = Line(StartPoint=explode_tree.Branch0, EndPoint=explode_tree.Branch1)

explode_tree_2 = ExplodeTree(Data=divide_curve_2.Points)  # -> Branch0, Branch1, Branch2, Branch3, Branch4, Branch5, Branch6, Branch7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
line_4 = Line(StartPoint=explode_tree_2.Branch4, EndPoint=explode_tree_2.Branch5)
line_5 = Line(StartPoint=explode_tree_2.Branch0, EndPoint=explode_tree_2.Branch1)
line_6 = Line(StartPoint=explode_tree_2.Branch1, EndPoint=explode_tree_2.Branch2)
line_7 = Line(StartPoint=explode_tree_2.Branch2, EndPoint=explode_tree_2.Branch3)
line_8 = Line(StartPoint=explode_tree_2.Branch3, EndPoint=explode_tree_2.Branch4)
line_9 = Line(StartPoint=explode_tree_2.Branch9, EndPoint=explode_tree_2.Branch10)
line_10 = Line(StartPoint=explode_tree_2.Branch5, EndPoint=explode_tree_2.Branch6)
line_11 = Line(StartPoint=explode_tree_2.Branch6, EndPoint=explode_tree_2.Branch7)
line_12 = Line(StartPoint=explode_tree_2.Branch7, EndPoint=explode_tree_2.Branch8)
line_13 = Line(StartPoint=explode_tree_2.Branch8, EndPoint=explode_tree_2.Branch9)

tree_branch = TreeBranch(Tree=divide_curve_2.Points, Path=Slider(1, range=0..10), MaintainPaths=True)
tree_branch_2 = TreeBranch(Tree=divide_curve_2.Points, Path=Slider(1, range=0..10), MaintainPaths=True)
tree_branch_3 = TreeBranch(Tree=divide_curve_2.Points, Path=Slider(0, range=0..10), MaintainPaths=True)
tree_branch_4 = TreeBranch(Tree=divide_curve_2.Points, Path=Slider(1, range=0..10), MaintainPaths=True)
tree_branch_5 = TreeBranch(Tree=divide_curve_2.Points, Path=Slider(0, range=0..10), MaintainPaths=True)
tree_branch_6 = TreeBranch(Tree=divide_curve_2.Points, Path=Slider(1, range=0..10), MaintainPaths=True)
tree_branch_7 = TreeBranch(Tree=divide_curve_2.Points, Path=Slider(0, range=0..10), MaintainPaths=True)
tree_branch_8 = TreeBranch(Tree=divide_curve_2.Points, Path=Slider(0, range=0..10), MaintainPaths=True)
line_14 = Line(StartPoint=tree_branch, EndPoint=tree_branch_3)

list_item_4 = ListItem(List=divide_curve_2.Points, Index=Slider(0, range=0..10), Wrap=True)  # -> flatten(Item)
panel_7 = Panel(list_item_4)
split_list = SplitList(List=list_item_4, Index=Slider(4, range=0..10))  # -> ListA, ListB
polyline_5 = PolyLine(Vertices=split_list.ListA, Closed=False)
polyline_6 = PolyLine(Vertices=split_list.ListB, Closed=False)

boolean_toggle = BooleanToggle(True)

flip_matrix = FlipMatrix(Data=divide_curve_2.Points)  # -> simplify(Data)
param_viewer_3 = ParamViewer(flip_matrix)
polyline_7 = PolyLine(Vertices=flip_matrix, Closed=boolean_toggle)  # -> flatten(Polyline)
panel_8 = Panel(flip_matrix)
list_item_5 = ListItem(List=polyline_7, Index=Slider(1, range=0..10), Wrap=True)

partition_list = PartitionList(List=flip_matrix, Size=number_slider)
shift_list_2 = ShiftList(List=simplify(flip_matrix), Shift=1, Wrap=True)
param_viewer_4 = ParamViewer(shift_list_2)
panel_10 = Panel(shift_list_2)
polyline_8 = PolyLine(Vertices=shift_list_2, Closed=boolean_toggle)  # -> flatten(Polyline)
loft = Loft(Curves=polyline_8, Options={Adjust=False, Closed=False, LoftEnds=0, LoftSimp=0, LoftType=0, Rebuild=10, Refit=0.01})
panel_11 = Panel(partition_list)
