# Grasshopper definition Playing around.gh (Grasshopper 1.0.7)
# plug-ins: Pufferfish

msphere = MeshSphere(Base=PlaneXY(0, 0, 0), Radius=Slider(3, range=0..10), UCount=10, VCount=20)
demesh = DeconstructMesh(Mesh=msphere)  # -> Vertices, Faces, Colours, Normals
facen = FaceNormals(Mesh=msphere)  # -> Centers, Normals
meval = MeshEval(Mesh=msphere)  # -> Point, Normal, Colour
item = ListItem(List=demesh.Vertices, Index=Slider(181, range=0..181), Wrap=True)
srfpt = SurfacePoints()  # -> Points, Weights, Greville, UCount, VCount
voronoi³ = Voronoi3D(Points=srfpt.Points, Box=msphere)  # -> Cells, Boundary
evalsrf = EvaluateSurface()  # -> Point, Normal, UDirection, VDirection, Frame
netsrf = NetOnSurface(CountU=srfpt.UCount, CountV=srfpt.VCount, Flip=False)
